# Grasshopper definition Hemp Globe.gh (Grasshopper 1.0.7)
# plug-ins: Geospatial, Urbano, Bifocals, horsterCameraControl, Human, Wombat

# ----
# World hemp data
https_www_fao_org_faostat = FilePath("D:\WORK IAAC\submissions\Computational design\globe\FAOSTAT_data_hemp.csv")
file = ReadFile(File=https_www_fao_org_faostat, PerLineParse=True)

# ----
# geojson countries boundaries
path = FilePath("D:\WORK IAAC\QGIS_base\Global scale\countries.geojson")
readjson = ReadGeoJSON(File=path, String="string", Mode=False)  # -> Type, Geometry, Keys, Values

branch = TreeBranch(Tree=simplify(readjson.Keys), Path="{3}", MaintainPaths=True)

# ----
# unwrapped data of geo lines
path_2 = FilePath("D:\WORK IAAC\submissions\Computational design\globe\global graticules.geojson")
panel = Panel(path_2)
readjson_2 = ReadGeoJSON(File=path_2)  # -> Type, Geometry, Keys, Values

panel_2 = Panel(branch)
meta = CreateMetadata(KeysInMetadata=readjson.Keys, ValuesInMetadata=readjson.Values)

# ----
# construct metadata
panel_3 = Panel(",")
split = SplitList(List=flatten(file), Index=1)  # -> ListA, ListB
split_2 = TextSplit(Text=split.ListA, Separators=panel_3)
split_3 = TextSplit(Text=split.ListB, Separators=panel_3)
meta_2 = CreateMetadata(KeysInMetadata=split_2, ValuesInMetadata=split_3)  # -> simplify(Metadata)
item = ListItem(List=split_2, Index="9", Wrap=True)
panel_4 = Panel(item)

panel_5 = Panel(split_2)
item_2 = ListItem(List=panel_2, Index=Slider(0, range=0..4), Wrap=True)
lookup = LookupMetadata(MetadataGeometry=meta, SearchKey=item_2)  # -> flatten(Value)

rep = ReplaceText(Text=lookup, Find="Russia", Replace="Russian Federation", RecursiveReplace=False)

# ----
# filter by year
lookup_2 = LookupMetadata(MetadataGeometry=meta_2, SearchKey=panel_4)  # -> flatten(Value)
cset = CreateSet(List=lookup_2)  # -> Set, Map
bnd = Bounds(Numbers=cset.Set)
dedomain = DeconstructDomain(Domain=bnd)  # -> Start, End
mindex = MemberIndex(Set=lookup_2, Member="2020")  # -> Index, Count
panel_6 = Panel(dedomain.End)
concat = Concatenate(FragmentA="{", FragmentB=mindex.Index, FragmentC="}")
branch_2 = TreeBranch(Tree=meta_2, Path=concat, MaintainPaths=True)

crv = Curve(readjson.Geometry)
crv_2 = Curve(readjson_2.Geometry)
group = Group(Objects=flatten(crv_2))

# ----
# filter by element
panel_7 = Panel("5")
item_3 = ListItem(List=split_2, Index=panel_7, Wrap=True)
panel_8 = Panel(item_3)
lookup_3 = LookupMetadata(MetadataGeometry=branch_2, SearchKey=panel_8)  # -> flatten(Value)
path_mapper = PathMapper(branch_2, source="{A}", target="{path_index}")
mindex_2 = MemberIndex(Set=lookup_3, Member="Area harvested")  # -> Index, Count
concat_2 = Concatenate(FragmentA="{", FragmentB=mindex_2.Index, FragmentC="}")
branch_3 = TreeBranch(Tree=path_mapper, Path=concat_2, MaintainPaths=True)

bbox = BoundingBox(Content=group, Plane=PlaneXY(0, 0, 0))  # -> Box, Box_2

# ----
# shaping planet Earth
number_slider = Slider(500, range=0..1000)
colour = ColourPicker(PickedColour=RGB(110, 130, 186))
sph = Sphere(Base=PlaneXY(0, 0, 0), Radius=expr("x*0.95", number_slider))
sph_2 = Sphere(Base=PlaneXY(0, 0, 0), Radius=number_slider)
srf = Surface(bbox.Box)
preview = CustomPreview(Geometry=sph, Material=colour)
volume = Volume(Geometry=sph_2)  # -> Volume, Centroid
map_srf = MapToSurface(Curve=crv, Source=srf, Target=sph_2)  # -> simplify(Curve)
boundarym = BoundaryMesh(Polyline=map_srf)

# ----
# split data by country only
panel_9 = Panel("3")
item_4 = ListItem(List=split_2, Index=panel_9, Wrap=True)
panel_10 = Panel(item_4)
lookup_4 = LookupMetadata(MetadataGeometry=branch_3, SearchKey=panel_10)  # -> flatten(Value)
mindex_3 = MemberIndex(Set=lookup_4, Member="World")  # -> Index, Count
series = Series(Start=0, Step=1, Count=mindex_3.Index)
path_mapper_2 = PathMapper(branch_3, source="{A}", target="{path_index}")
concat_3 = Concatenate(FragmentA="{", FragmentB=series, FragmentC="}")
branch_4 = TreeBranch(Tree=path_mapper_2, Path=concat_3, MaintainPaths=True)

panel_11 = Panel(lookup_4)

# ----
# remove data branches with lowest outlayer
panel_12 = Panel("11")
item_5 = ListItem(List=split_2, Index=panel_12, Wrap=True)
panel_13 = Panel(item_5)
lookup_5 = LookupMetadata(MetadataGeometry=branch_4, SearchKey=panel_13)  # -> flatten(Value)
larger = LargerThan(FirstNumber=lookup_5, SecondNumber="10")  # -> LargerThan, OrEqualTo
path_mapper_3 = PathMapper(branch_4, source="{A}", target="{path_index}")
nullrep = ReplaceNulls(Items=larger.LargerThan, Replacements=False)  # -> Items, Count
panel_14 = Panel(nullrep.Items)
mindex_4 = MemberIndex(Set=panel_14, Member="True")  # -> Index, Count
concat_4 = Concatenate(FragmentA="{", FragmentB=mindex_4.Index, FragmentC="}")
branch_5 = TreeBranch(Tree=path_mapper_3, Path=concat_4, MaintainPaths=True)

# ----
# data to show
number_slider_2 = Slider(11, range=0..14)
item_6 = ListItem(List=split_2, Index=number_slider_2, Wrap=True)
item_7 = ListItem(List=split_2, Index=Slider(3, range=0..14), Wrap=True)
panel_15 = Panel(item_6)
panel_16 = Panel(item_7)
lookup_6 = LookupMetadata(MetadataGeometry=branch_5, SearchKey=panel_15)  # -> flatten(Value)
lookup_7 = LookupMetadata(MetadataGeometry=branch_5, SearchKey=panel_16)  # -> flatten(Value)

panel_17 = Panel(lookup_6)
panel_18 = Panel(lookup_7)

# ----
# formatting names
panel_19 = Panel("PRC")
rep_2 = ReplaceText(Text=panel_18, Find="China mainland", Replace=panel_19, RecursiveReplace=False)
rep_3 = ReplaceText(Text=rep_2, Find="China", Replace="Taiwan", RecursiveReplace=False)
rep_4 = ReplaceText(Text=rep_3, Find=panel_19, Replace="China", RecursiveReplace=False)
rep_5 = ReplaceText(Text=rep_4, Find="Democratic People's Republic of Korea", Replace="North Korea", RecursiveReplace=False)
rep_6 = ReplaceText(Text=rep_5, Find="Republic of Korea", Replace="South Korea", RecursiveReplace=False)
rep_7 = ReplaceText(Text=rep_6, Find="Czechia", Replace="Czech Republic", RecursiveReplace=False)
panel_20 = Panel(rep_7)
txt = Text(panel_20)

mindex_5 = MemberIndex(Set=rep, Member=txt)  # -> flatten(Index), Count
panel_21 = Panel(mindex_5.Index)

# ----
# selection countries and centroids
concat_5 = Concatenate(FragmentA="{", FragmentB=mindex_5.Index, FragmentC=";", FragmentD="*", FragmentE="}")
split_4 = SplitTree(Data=boundarym, Masks=flatten(concat_5))  # -> Positive, Negative
path_mapper_4 = PathMapper(split_4.Positive, source=["{A}", "{A;B}"], target=["{A}", "{A}"])
area = Area(Geometry=path_mapper_4)  # -> Area, Centroid
sort = SortList(Keys=area.Area, ValuesA=path_mapper_4)  # -> flatten(Keys), ValuesA
item_8 = ListItem(List=reverse(sort.ValuesA), Index=0, Wrap=False)  # -> flatten(Item)
area_2 = Area(Geometry=item_8)  # -> Area, Centroid

sort_pt = SortPoints(Points=area_2.Centroid)  # -> Points, Indices
pt = Point(sort_pt.Points)

# ----
# automate camera focus
number_slider_3 = Slider(0, range=0..21)
pt_2 = Point(flatten(sort_pt.Points))
animate = Slider(36.973, range=0..50)
item_9 = ListItem(List=pt_2, Index=number_slider_3, Wrap=True)
vec2pt = Vector2Pt(PointA=volume.Centroid, PointB=pt_2, Unitize=False)  # -> Vector, Length
multiplication = Multiplication(A=vec2pt.Vector, B="3")
move = Move(Geometry=pt_2, Motion=multiplication)  # -> Geometry, Transform
item_10 = ListItem(List=move.Geometry, Index=number_slider_3, Wrap=True)
setcam = SetCamera(CameraLocation=item_10, TargetLocation=volume.Centroid, LensLength=animate, Activate=Toggle(False))

# ----
# equator
lng = ListLength(List=flatten(readjson.Type))
cir = Circle(Plane=volume.Centroid, Radius=expr("1.1*x", number_slider))
divide = DivideCurve(Curve=cir, Count=lng, Kinks=False)  # -> Points, Tangents, Parameters
vec2pt_2 = Vector2Pt(PointA=volume.Centroid, PointB=divide.Points, Unitize=False)  # -> Vector, Length
offset = OffsetCurve(Curve=cir, Distance=-10, Corners=1)
line = LineSDL(Start=divide.Points, Direction=vec2pt_2.Vector, Length=100)
xy = XYPlane(Origin=divide.Points)
swatch = ColourSwatch(SwatchColor=RGB(13, 12, 12))
align = AlignPlane(Plane=xy, Direction=line)  # -> Plane, Angle
justified_text = JustifiedText3d(
    Location=align.Plane,
    Text=rep,
    Size=8,
    Color=swatch,
    HorizontalAlignment=0,
    VerticalAlginment=1,
    UseMeshes=False,
    Bake=False)
previewlw = CustomPreviewLineweights(Geometry=offset, Shader=swatch, Thickness="1", Absolute=False)

# ----
# points for data
pt_3 = Point(volume.Centroid)
pt_4 = Point(pt)
vec2pt_3 = Vector2Pt(PointA=pt_3, PointB=pt_4, Unitize=False)  # -> Vector, Length
multiplication_2 = Multiplication(A=vec2pt_3.Vector, B=Slider(0.02, range=0..2))
move_2 = Move(Geometry=pt_4, Motion=multiplication_2)  # -> Geometry, Transform

# ----
# Earth axis
Z = UnitZ(Factor=1)  # -> expr("-x", UnitVector)
Z_2 = UnitZ(Factor=1)
line_2 = LineSDL(Start=volume.Centroid, Direction=[Z_2, Z], Length=expr("x*1.2", number_slider))
previewlw_2 = CustomPreviewLineweights(Geometry=line_2, Shader=ColourSwatch(SwatchColor=RGB(252, 252, 252)), Thickness="3", Absolute=False)

# ----
# renumber text data according points
# (I have been forced to do that `cause
#  had not time to sort out with complex tree structures)
panel_22 = Panel("""20
10
12
8
2
0
1
17
6
19
9
14
11
15
21
13
3
18
5
7
4
16""")
txt_2 = Text(txt)
lng_2 = ListLength(List=txt_2)
item_11 = ListItem(List=txt_2, Index=panel_22, Wrap=True)
series_2 = Series(Start=0, Step=1, Count=lng_2)
replace = ReplaceItems(List=txt_2, Item=item_11, Indices=series_2, Wrap=False)
panel_23 = Panel(replace)

countries = Text(replace)

# ----
# countries borders
swatch_2 = ColourSwatch(SwatchColor=RGB(13, 12, 12))
crv_3 = Curve(map_srf)
previewlw_3 = CustomPreviewLineweights(Geometry=crv_3, Shader=swatch_2, Thickness="1", Absolute=False)

txt_3 = Text(panel_17)
lng_3 = ListLength(List=txt_3)
item_12 = ListItem(List=txt_3, Index=panel_22, Wrap=True)
series_3 = Series(Start=0, Step=1, Count=lng_3)
replace_2 = ReplaceItems(List=txt_3, Item=item_12, Indices=series_3, Wrap=False)
panel_24 = Panel(replace_2)

areas = Text(replace_2)
data = Data(areas)

# ----
# selected countires on screen
number_slider_4 = Slider(15.61, range=10..20)
txt_4 = Text(panel_24)
txt_5 = Text(panel_23)
lng_4 = ListLength(List=txt_5)
series_4 = Series(Start=0, Step=1, Count=lng_4)
multiplication_3 = Multiplication(A=series_4, B=number_slider_4)
addition = Addition(A="15", B=multiplication_3)
concat_6 = Concatenate(FragmentA="15", FragmentD=",", FragmentB=addition, FragmentE=",", FragmentC="0")
texttoscreen = RenderTextToScreen(Text=txt_5, Location=concat_6, Size="10", Color=ColourSwatch(SwatchColor=RGB(255, 252, 252)), m_scWithvp=False)

panel_25 = Panel(data)

item_13 = ListItem(List=txt_4, Index=number_slider_3, Wrap=True)
item_14 = ListItem(List=concat_6, Index=number_slider_3, Wrap=True)
item_15 = ListItem(List=txt_5, Index=number_slider_3, Wrap=True)
concat_7 = Concatenate(FragmentA=item_15, FragmentC="  > ", FragmentB=item_13, FragmentD=" hectares in 2020")
texttoscreen_2 = RenderTextToScreen(Text=concat_7, Location=item_14, Size="10", Color=ColourSwatch(SwatchColor=RGB(23, 21, 21)), m_scWithvp=False)

# ----
# show data
number_slider_5 = Slider(1, range=0..100)
number_slider_6 = Slider(11, range=0..100)
bnd_2 = Bounds(Numbers=data)
dom = ConstructDomain(DomainStart=number_slider_5, DomainEnd=number_slider_6)
remap = RemapNumbers(Value=data, Source=bnd_2, Target=dom)  # -> Mapped, Clipped
multiplication_4 = Multiplication(A=remap.Mapped, B=Slider(9, range=0..10))
gradient = Gradient(
    LowerLimit=0,
    UpperLimit=number_slider_6,
    Parameter=remap.Mapped,
    stops=[0: RGB(243, 57, 0), 0.1: RGB(236, 27, 60), 0.2: RGB(210, 0, 118), 0.3: RGB(103, 0, 120), 0.4: RGB(39, 72, 161), 0.5: RGB(1, 192, 229), 0.6: RGB(18, 178, 90), 0.7: RGB(79, 186, 8), 0.8: RGB(220, 237, 32), 0.9: RGB(247, 159, 20), 1: RGB(243, 57, 0)])
line_3 = LineSDL(Start=move_2.Geometry, Direction=vec2pt_3.Vector, Length=multiplication_4)

# ----
# screen bar legend
panel_26 = Panel("250")
concat_8 = Concatenate(FragmentA=panel_26, FragmentD=",", FragmentB=addition, FragmentE=",", FragmentC="0")
pt_5 = ConstructPoint(XCoordinate=expr("-x", multiplication_4), YCoordinate=5, ZCoordinate=0)
rec_2pt = Rectangle2Pt(Plane=PlaneXY(0, 0, 0), PointA=Point(0, 0, 0), PointB=pt_5, Radius=0)  # -> Rectangle, Length
crvtoscreen = RenderCurveToScreen(
    Curve=rec_2pt.Rectangle,
    Location=concat_8,
    ScaleFactor=Slider(1.5, range=0..10),
    Color=gradient,
    Thickness=1,
    Depth=0.95,
    Fixed=True,
    m_scWithvp=False)

pipe = Pipe(Curve=line_3, Radius=5, Caps=1)  # -> flatten(Pipe)

preview_2 = CustomPreview(Geometry=pipe, Material=gradient)
